# Grasshopper definition weaving_definition.gh (Grasshopper 1.0.7)

# ---- group: tween crvs
range = Range(Domain=Domain(0, 1), Steps=Slider(18, range=0..35))

# ---- group: control horizontal crvs
number_slider = Slider(13, range=0..16)
number_slider_2 = Slider(1.8, range=0..10)
number_slider_3 = Slider(4.5, range=0..10)
toggle = BooleanToggle(False)

# ---- group: linear array
number_slider_4 = Slider(14, range=0..16)
number_slider_5 = Slider(6, range=0..12)

# ---- group: length of base crv
# install ......Pufferfish
number_slider_6 = Slider(110, range=0..120)

# ----
python = GhPythonScript(
    len_ln=number_slider_6,
    height=number_slider_5,
    array_num=number_slider_4,
    div_count=number_slider,
    amplitude=number_slider_3,
    invert=toggle,
    rad_fillet=number_slider_2,
    tween_factor=range)  # -> fillet_crvs, tween_lines; inputs len_ln: Int32, height: Int32, array_num: Int32, div_count: Int32, invert: Boolean, tween_factor: list
# ---------- python: Python ----------
import Grasshopper as ghc
import ghpythonlib.components as gh

# 1. generate base curves
def generate_curves(len_ln,height,array_num):
    line = gh.LineSDL(gh.ConstructPoint(12,12,0),gh.UnitX(1),len_ln)
    return (gh.LinearArray(line,gh.UnitZ(height),array_num)[0])

crvs= generate_curves(len_ln,height,array_num)

# 2. divide + move points
def move_points(crvs,array_num,div_count,amplitude,invert):
    new_pts = ghc.DataTree[object]() 
    for i in range(array_num):
        path = ghc.Kernel.Data.GH_Path(i)
        division_pts= gh.DivideCurve(crvs[i],div_count,False)[0]
        
        #move points
        invert_row = (i % 2 != 0)#If this curve is odd → flip the pattern
        
        if invert:
            invert_row = not invert_row
            
        for k in range(len(division_pts)):
            if invert_row:
                move_condition = (k % 2 != 0)
            else:
                move_condition = (k % 2 == 0)
                
            if move_condition:
                new_pts.Add(gh.Move(division_pts[k], gh.UnitY(-amplitude))[0],path)
            else:
                new_pts.Add(division_pts[k], path)
    return new_pts

deformed_pts= move_points(crvs,array_num,div_count,amplitude,invert)

# 3. build fillet curves....create line from moved points
def build_curves(deformed_pts,rad_fillet):
    f_crvs = ghc.DataTree[object]()
    for i in range(deformed_pts.BranchCount):
        path = deformed_pts.Path(i)
        f_crvs.Add(gh.FilletDistance(gh.PolyLine(deformed_pts.Branch(i),False),rad_fillet), path)
    return f_crvs

fillet_crvs= build_curves(deformed_pts,rad_fillet)

# 4. generate tween points
def tween_points(fillet_crvs,deformed_pts,tween_factor):
    tween_tree = ghc.DataTree[object]() 
    for i in range(fillet_crvs.BranchCount):
        branch_pts = deformed_pts.Branch(i)  
        branch_crv = fillet_crvs.Branch(i)[0] #a single curve not a list
        #tween two points on curve
        projected_pts= gh.PullPoint(branch_pts,branch_crv)[0]
        sub_ind = 0  # reset for each valid i
        for j in range(len(projected_pts)-1):
            if j % 2 != 0: #Odd index
                new_path = ghc.Kernel.Data.GH_Path(i, sub_ind)
                tw_pts= gh.Pufferfish.TweenTwoPointsOnCurve(projected_pts[j],projected_pts[j+1],branch_crv,tween_factor,False)
                for pt in tw_pts:
                    tween_tree.Add(pt, new_path)
                sub_ind += 1 # increment sub index
    return tween_tree

points= tween_points(fillet_crvs,deformed_pts,tween_factor)

# 5. data tree operations

def shift_tree(points):
    max_first = max(points.Path(i)[0] for i in range(points.BranchCount))
    
    tr_A = ghc.DataTree[object]() 
    tr_B = ghc.DataTree[object]() 
    
    for i in range(points.BranchCount):
        path = points.Path(i)
        
        for item in points.Branch(i):
            if path[0] != 0: #skip first group
                tr_A.Add(item, path)
                
            if path[0] != max_first: #remove last branch
                tr_B.Add(item, path)
    return tr_A, tr_B

shifted_trees = shift_tree(points)
tree_A= shifted_trees[0]
tree_B= shifted_trees[1]

# 6. connect trees
def connect_branches(tree_A,tree_B):
    tw_lines = ghc.DataTree[object]()
    
    #tween crvs
    for i in range(tree_B.BranchCount):
        path = tree_B.Path(i)
        branch_A = tree_A.Branch(i) 
        branch_B = tree_B.Branch(i)
        
        for j in range(min(len(branch_A), len(branch_B))):
            tw_lines.Add(gh.Line(branch_A[j], branch_B[j]), path)
    return tw_lines

tween_lines= connect_branches(tree_A,tree_B)
# ---------- end python ----------
preview = CustomPreview(Geometry=python.fillet_crvs, Material=ColourSwatch(SwatchColor=RGB(102, 44, 44)))
preview_2 = CustomPreview(Geometry=python.tween_lines, Material=ColourSwatch(SwatchColor=RGB(235, 163, 96)))
